# Grasshopper definition MVK_parametric.gh (Grasshopper 1.0.8)

# ---- group: Shared settings
# README: MVK site model - one group per building. Shared settings are in this top band; their wires are hidden.
# In each group: ground / upper use, floors (0 = site data), partition system, Detail (full 3D layout or massing),
# overrides JSON, walls to remove (ids), walls to add (lines). The blue panel shows that building's cost and carbon.
# Show IDs = true to see wall / door ids. Cost & carbon: Marievik+ catalogue; existing shells are retained.
# Previews and the Site summary are on the right. Export = true writes Marievik+\runs\grasshopper\Bxx.json.
lib = Panel("C:\Users\saraabo\Desktop\Marievik_parametric")
marievik_folder = Panel("C:\Users\saraabo\Desktop\Marievik+")
existing_shell_conversion = BooleanToggle(True)
show_ids = BooleanToggle(False)
show_floor_1_all = Slider(-1, range=-1..19)
export_to_dashboard_each_building = BooleanToggle(False)
facade_materials_roof_detail = BooleanToggle(True)

# ---- group: B01 Marievik 27 - vaulted-roof office (the study building)
# Name: Marievik 27 - vaulted-roof office (the study building)  (7 floors, today office)
add_walls_lines = Curve()
ground_floor_use = ValueList({"Current use (site data)": "site", "Office - open plan": "office_open", "Office - cellular rooms": "office_cellular", "Residential - apartments": "residential", "Hotel - guest rooms": "hotel", "School - classrooms": "school", "Retail / restaurant (ground floor)": "retail"}, selected="Current use (site data)")
upper_floors_use = ValueList({"Current use (site data)": "site", "Office - open plan": "office_open", "Office - cellular rooms": "office_cellular", "Residential - apartments": "residential", "Hotel - guest rooms": "hotel", "School - classrooms": "school", "Retail / restaurant (ground floor)": "retail"}, selected="Current use (site data)")
partition_system = ValueList({"As in use profile": "as_profile", "Conventional stud": "conventional", "Demountable": "demountable", "Glazed": "glass"}, selected="As in use profile")
building = Panel("B01")
overrides_json = Panel("{}")
remove_walls_one_id_per_line = Panel("")
floors_0_site_7 = Slider(0, range=0..30)
detail_full_layout = BooleanToggle(True)
mvk_b01 = Python3Script(
    building=building,
    ground_use=ground_floor_use,
    use=upper_floors_use,
    floors=floors_0_site_7,
    partition_system=partition_system,
    detail=detail_full_layout,
    overrides=overrides_json,
    remove_walls=remove_walls_one_id_per_line,
    add_walls=add_walls_lines,
    existing_shell=existing_shell_conversion,
    show_ids=show_ids,
    show_floor=show_floor_1_all,
    export=export_to_dashboard_each_building,
    lib=lib,
    mvplus=marievik_folder,
    facade_on=facade_materials_roof_detail)  # -> out, walls, windows, doors, slabs, massing, rooms, room_pts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; inputs remove_walls: list, add_walls: list
# ---------- mvk_b01: Python ----------
#! python3
# r: shapely
# MVK Building: the real code lives in <lib>/gh/mvk_building.py (edit it there, then recompute).
import os
_LIB = lib if lib else r"C:\Users\saraabo\Desktop\Marievik_parametric"
exec(open(os.path.join(_LIB, "gh", "mvk_building.py"), encoding="utf-8").read())
# ---------- end mvk_b01 ----------
b01_summary = Panel(mvk_b01.summary)

# ---- group: B02 Marievik 19 - H&M office
# Name: Marievik 19 - H&M office  (8 floors, today office)
add_walls_lines_2 = Curve()
ground_floor_use_2 = ValueList({"Current use (site data)": "site", "Office - open plan": "office_open", "Office - cellular rooms": "office_cellular", "Residential - apartments": "residential", "Hotel - guest rooms": "hotel", "School - classrooms": "school", "Retail / restaurant (ground floor)": "retail"}, selected="Current use (site data)")
upper_floors_use_2 = ValueList({"Current use (site data)": "site", "Office - open plan": "office_open", "Office - cellular rooms": "office_cellular", "Residential - apartments": "residential", "Hotel - guest rooms": "hotel", "School - classrooms": "school", "Retail / restaurant (ground floor)": "retail"}, selected="Current use (site data)")
partition_system_2 = ValueList({"As in use profile": "as_profile", "Conventional stud": "conventional", "Demountable": "demountable", "Glazed": "glass"}, selected="As in use profile")
building_2 = Panel("B02")
overrides_json_2 = Panel("{}")
remove_walls_one_id_per_line_2 = Panel("")
floors_0_site_8 = Slider(0, range=0..30)
detail_full_layout_2 = BooleanToggle(False)
mvk_b02 = Python3Script(
    building=building_2,
    ground_use=ground_floor_use_2,
    use=upper_floors_use_2,
    floors=floors_0_site_8,
    partition_system=partition_system_2,
    detail=detail_full_layout_2,
    overrides=overrides_json_2,
    remove_walls=remove_walls_one_id_per_line_2,
    add_walls=add_walls_lines_2,
    existing_shell=existing_shell_conversion,
    show_ids=show_ids,
    show_floor=show_floor_1_all,
    export=export_to_dashboard_each_building,
    lib=lib,
    mvplus=marievik_folder,
    facade_on=facade_materials_roof_detail)  # -> out, walls, windows, doors, slabs, massing, rooms, room_pts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; inputs remove_walls: list, add_walls: list; same code as mvk_b01
b02_summary = Panel(mvk_b02.summary)

# ---- group: B03 Marievik 26 - Roots & Soil / Cisco / SATS block
# Name: Marievik 26 - Roots & Soil / Cisco / SATS block  (7 floors, today office)
add_walls_lines_3 = Curve()
ground_floor_use_3 = ValueList({"Current use (site data)": "site", "Office - open plan": "office_open", "Office - cellular rooms": "office_cellular", "Residential - apartments": "residential", "Hotel - guest rooms": "hotel", "School - classrooms": "school", "Retail / restaurant (ground floor)": "retail"}, selected="Current use (site data)")
upper_floors_use_3 = ValueList({"Current use (site data)": "site", "Office - open plan": "office_open", "Office - cellular rooms": "office_cellular", "Residential - apartments": "residential", "Hotel - guest rooms": "hotel", "School - classrooms": "school", "Retail / restaurant (ground floor)": "retail"}, selected="Current use (site data)")
partition_system_3 = ValueList({"As in use profile": "as_profile", "Conventional stud": "conventional", "Demountable": "demountable", "Glazed": "glass"}, selected="As in use profile")
building_3 = Panel("B03")
overrides_json_3 = Panel("{}")
remove_walls_one_id_per_line_3 = Panel("")
floors_0_site_7_2 = Slider(0, range=0..30)
detail_full_layout_3 = BooleanToggle(False)
mvk_b03 = Python3Script(
    building=building_3,
    ground_use=ground_floor_use_3,
    use=upper_floors_use_3,
    floors=floors_0_site_7_2,
    partition_system=partition_system_3,
    detail=detail_full_layout_3,
    overrides=overrides_json_3,
    remove_walls=remove_walls_one_id_per_line_3,
    add_walls=add_walls_lines_3,
    existing_shell=existing_shell_conversion,
    show_ids=show_ids,
    show_floor=show_floor_1_all,
    export=export_to_dashboard_each_building,
    lib=lib,
    mvplus=marievik_folder,
    facade_on=facade_materials_roof_detail)  # -> out, walls, windows, doors, slabs, massing, rooms, room_pts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; inputs remove_walls: list, add_walls: list; same code as mvk_b01
b03_summary = Panel(mvk_b03.summary)

# ---- group: B04 The Absolut Group / Plåtparken (glass atrium)
# Name: The Absolut Group / Plåtparken (glass atrium)  (9 floors, today office)
add_walls_lines_4 = Curve()
ground_floor_use_4 = ValueList({"Current use (site data)": "site", "Office - open plan": "office_open", "Office - cellular rooms": "office_cellular", "Residential - apartments": "residential", "Hotel - guest rooms": "hotel", "School - classrooms": "school", "Retail / restaurant (ground floor)": "retail"}, selected="Current use (site data)")
upper_floors_use_4 = ValueList({"Current use (site data)": "site", "Office - open plan": "office_open", "Office - cellular rooms": "office_cellular", "Residential - apartments": "residential", "Hotel - guest rooms": "hotel", "School - classrooms": "school", "Retail / restaurant (ground floor)": "retail"}, selected="Current use (site data)")
partition_system_4 = ValueList({"As in use profile": "as_profile", "Conventional stud": "conventional", "Demountable": "demountable", "Glazed": "glass"}, selected="As in use profile")
building_4 = Panel("B04")
overrides_json_4 = Panel("{}")
remove_walls_one_id_per_line_4 = Panel("")
floors_0_site_9 = Slider(0, range=0..30)
detail_full_layout_4 = BooleanToggle(False)
mvk_b04 = Python3Script(
    building=building_4,
    ground_use=ground_floor_use_4,
    use=upper_floors_use_4,
    floors=floors_0_site_9,
    partition_system=partition_system_4,
    detail=detail_full_layout_4,
    overrides=overrides_json_4,
    remove_walls=remove_walls_one_id_per_line_4,
    add_walls=add_walls_lines_4,
    existing_shell=existing_shell_conversion,
    show_ids=show_ids,
    show_floor=show_floor_1_all,
    export=export_to_dashboard_each_building,
    lib=lib,
    mvplus=marievik_folder,
    facade_on=facade_materials_roof_detail)  # -> out, walls, windows, doors, slabs, massing, rooms, room_pts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; inputs remove_walls: list, add_walls: list; same code as mvk_b01
b04_summary = Panel(mvk_b04.summary)

# ---- group: B05 Marieviksgatan slab, east (Heidelberg Materials)
# Name: Marieviksgatan slab, east (Heidelberg Materials)  (7 floors, today office)
add_walls_lines_5 = Curve()
ground_floor_use_5 = ValueList({"Current use (site data)": "site", "Office - open plan": "office_open", "Office - cellular rooms": "office_cellular", "Residential - apartments": "residential", "Hotel - guest rooms": "hotel", "School - classrooms": "school", "Retail / restaurant (ground floor)": "retail"}, selected="Current use (site data)")
upper_floors_use_5 = ValueList({"Current use (site data)": "site", "Office - open plan": "office_open", "Office - cellular rooms": "office_cellular", "Residential - apartments": "residential", "Hotel - guest rooms": "hotel", "School - classrooms": "school", "Retail / restaurant (ground floor)": "retail"}, selected="Current use (site data)")
partition_system_5 = ValueList({"As in use profile": "as_profile", "Conventional stud": "conventional", "Demountable": "demountable", "Glazed": "glass"}, selected="As in use profile")
building_5 = Panel("B05")
overrides_json_5 = Panel("{}")
remove_walls_one_id_per_line_5 = Panel("")
floors_0_site_7_3 = Slider(0, range=0..30)
detail_full_layout_5 = BooleanToggle(False)
mvk_b05 = Python3Script(
    building=building_5,
    ground_use=ground_floor_use_5,
    use=upper_floors_use_5,
    floors=floors_0_site_7_3,
    partition_system=partition_system_5,
    detail=detail_full_layout_5,
    overrides=overrides_json_5,
    remove_walls=remove_walls_one_id_per_line_5,
    add_walls=add_walls_lines_5,
    existing_shell=existing_shell_conversion,
    show_ids=show_ids,
    show_floor=show_floor_1_all,
    export=export_to_dashboard_each_building,
    lib=lib,
    mvplus=marievik_folder,
    facade_on=facade_materials_roof_detail)  # -> out, walls, windows, doors, slabs, massing, rooms, room_pts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; inputs remove_walls: list, add_walls: list; same code as mvk_b01
b05_summary = Panel(mvk_b05.summary)

# ---- group: B06 Marieviksgatan slab, west
# Name: Marieviksgatan slab, west  (7 floors, today office)
add_walls_lines_6 = Curve()
ground_floor_use_6 = ValueList({"Current use (site data)": "site", "Office - open plan": "office_open", "Office - cellular rooms": "office_cellular", "Residential - apartments": "residential", "Hotel - guest rooms": "hotel", "School - classrooms": "school", "Retail / restaurant (ground floor)": "retail"}, selected="Current use (site data)")
upper_floors_use_6 = ValueList({"Current use (site data)": "site", "Office - open plan": "office_open", "Office - cellular rooms": "office_cellular", "Residential - apartments": "residential", "Hotel - guest rooms": "hotel", "School - classrooms": "school", "Retail / restaurant (ground floor)": "retail"}, selected="Current use (site data)")
partition_system_6 = ValueList({"As in use profile": "as_profile", "Conventional stud": "conventional", "Demountable": "demountable", "Glazed": "glass"}, selected="As in use profile")
building_6 = Panel("B06")
overrides_json_6 = Panel("{}")
remove_walls_one_id_per_line_6 = Panel("")
floors_0_site_7_4 = Slider(0, range=0..30)
detail_full_layout_6 = BooleanToggle(False)
mvk_b06 = Python3Script(
    building=building_6,
    ground_use=ground_floor_use_6,
    use=upper_floors_use_6,
    floors=floors_0_site_7_4,
    partition_system=partition_system_6,
    detail=detail_full_layout_6,
    overrides=overrides_json_6,
    remove_walls=remove_walls_one_id_per_line_6,
    add_walls=add_walls_lines_6,
    existing_shell=existing_shell_conversion,
    show_ids=show_ids,
    show_floor=show_floor_1_all,
    export=export_to_dashboard_each_building,
    lib=lib,
    mvplus=marievik_folder,
    facade_on=facade_materials_roof_detail)  # -> out, walls, windows, doors, slabs, massing, rooms, room_pts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; inputs remove_walls: list, add_walls: list; same code as mvk_b01
b06_summary = Panel(mvk_b06.summary)

# ---- group: B07 East waterfront office (rounded corners)
# Name: East waterfront office (rounded corners)  (9 floors, today office)
add_walls_lines_7 = Curve()
ground_floor_use_7 = ValueList({"Current use (site data)": "site", "Office - open plan": "office_open", "Office - cellular rooms": "office_cellular", "Residential - apartments": "residential", "Hotel - guest rooms": "hotel", "School - classrooms": "school", "Retail / restaurant (ground floor)": "retail"}, selected="Current use (site data)")
upper_floors_use_7 = ValueList({"Current use (site data)": "site", "Office - open plan": "office_open", "Office - cellular rooms": "office_cellular", "Residential - apartments": "residential", "Hotel - guest rooms": "hotel", "School - classrooms": "school", "Retail / restaurant (ground floor)": "retail"}, selected="Current use (site data)")
partition_system_7 = ValueList({"As in use profile": "as_profile", "Conventional stud": "conventional", "Demountable": "demountable", "Glazed": "glass"}, selected="As in use profile")
building_7 = Panel("B07")
overrides_json_7 = Panel("{}")
remove_walls_one_id_per_line_7 = Panel("")
floors_0_site_9_2 = Slider(0, range=0..30)
detail_full_layout_7 = BooleanToggle(False)
mvk_b07 = Python3Script(
    building=building_7,
    ground_use=ground_floor_use_7,
    use=upper_floors_use_7,
    floors=floors_0_site_9_2,
    partition_system=partition_system_7,
    detail=detail_full_layout_7,
    overrides=overrides_json_7,
    remove_walls=remove_walls_one_id_per_line_7,
    add_walls=add_walls_lines_7,
    existing_shell=existing_shell_conversion,
    show_ids=show_ids,
    show_floor=show_floor_1_all,
    export=export_to_dashboard_each_building,
    lib=lib,
    mvplus=marievik_folder,
    facade_on=facade_materials_roof_detail)  # -> out, walls, windows, doors, slabs, massing, rooms, room_pts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; inputs remove_walls: list, add_walls: list; same code as mvk_b01
b07_summary = Panel(mvk_b07.summary)

# ---- group: B08 Årstaängsvägen west office (Alstom)
# Name: Årstaängsvägen west office (Alstom)  (7 floors, today office)
add_walls_lines_8 = Curve()
ground_floor_use_8 = ValueList({"Current use (site data)": "site", "Office - open plan": "office_open", "Office - cellular rooms": "office_cellular", "Residential - apartments": "residential", "Hotel - guest rooms": "hotel", "School - classrooms": "school", "Retail / restaurant (ground floor)": "retail"}, selected="Current use (site data)")
upper_floors_use_8 = ValueList({"Current use (site data)": "site", "Office - open plan": "office_open", "Office - cellular rooms": "office_cellular", "Residential - apartments": "residential", "Hotel - guest rooms": "hotel", "School - classrooms": "school", "Retail / restaurant (ground floor)": "retail"}, selected="Current use (site data)")
partition_system_8 = ValueList({"As in use profile": "as_profile", "Conventional stud": "conventional", "Demountable": "demountable", "Glazed": "glass"}, selected="As in use profile")
building_8 = Panel("B08")
overrides_json_8 = Panel("{}")
remove_walls_one_id_per_line_8 = Panel("")
floors_0_site_7_5 = Slider(0, range=0..30)
detail_full_layout_8 = BooleanToggle(False)
mvk_b08 = Python3Script(
    building=building_8,
    ground_use=ground_floor_use_8,
    use=upper_floors_use_8,
    floors=floors_0_site_7_5,
    partition_system=partition_system_8,
    detail=detail_full_layout_8,
    overrides=overrides_json_8,
    remove_walls=remove_walls_one_id_per_line_8,
    add_walls=add_walls_lines_8,
    existing_shell=existing_shell_conversion,
    show_ids=show_ids,
    show_floor=show_floor_1_all,
    export=export_to_dashboard_each_building,
    lib=lib,
    mvplus=marievik_folder,
    facade_on=facade_materials_roof_detail)  # -> out, walls, windows, doors, slabs, massing, rooms, room_pts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; inputs remove_walls: list, add_walls: list; same code as mvk_b01
b08_summary = Panel(mvk_b08.summary)

# ---- group: B09 West end block (Nordic Wellness + apartments)
# Name: West end block (Nordic Wellness + apartments)  (8 floors, today residential)
add_walls_lines_9 = Curve()
ground_floor_use_9 = ValueList({"Current use (site data)": "site", "Office - open plan": "office_open", "Office - cellular rooms": "office_cellular", "Residential - apartments": "residential", "Hotel - guest rooms": "hotel", "School - classrooms": "school", "Retail / restaurant (ground floor)": "retail"}, selected="Current use (site data)")
upper_floors_use_9 = ValueList({"Current use (site data)": "site", "Office - open plan": "office_open", "Office - cellular rooms": "office_cellular", "Residential - apartments": "residential", "Hotel - guest rooms": "hotel", "School - classrooms": "school", "Retail / restaurant (ground floor)": "retail"}, selected="Current use (site data)")
partition_system_9 = ValueList({"As in use profile": "as_profile", "Conventional stud": "conventional", "Demountable": "demountable", "Glazed": "glass"}, selected="As in use profile")
building_9 = Panel("B09")
overrides_json_9 = Panel("{}")
remove_walls_one_id_per_line_9 = Panel("")
floors_0_site_8_2 = Slider(0, range=0..30)
detail_full_layout_9 = BooleanToggle(False)
mvk_b09 = Python3Script(
    building=building_9,
    ground_use=ground_floor_use_9,
    use=upper_floors_use_9,
    floors=floors_0_site_8_2,
    partition_system=partition_system_9,
    detail=detail_full_layout_9,
    overrides=overrides_json_9,
    remove_walls=remove_walls_one_id_per_line_9,
    add_walls=add_walls_lines_9,
    existing_shell=existing_shell_conversion,
    show_ids=show_ids,
    show_floor=show_floor_1_all,
    export=export_to_dashboard_each_building,
    lib=lib,
    mvplus=marievik_folder,
    facade_on=facade_materials_roof_detail)  # -> out, walls, windows, doors, slabs, massing, rooms, room_pts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; inputs remove_walls: list, add_walls: list; same code as mvk_b01
b09_summary = Panel(mvk_b09.summary)

# ---- group: B10 Liljeholmskajen apartments, north slab
# Name: Liljeholmskajen apartments, north slab  (8 floors, today residential)
add_walls_lines_10 = Curve()
ground_floor_use_10 = ValueList({"Current use (site data)": "site", "Office - open plan": "office_open", "Office - cellular rooms": "office_cellular", "Residential - apartments": "residential", "Hotel - guest rooms": "hotel", "School - classrooms": "school", "Retail / restaurant (ground floor)": "retail"}, selected="Current use (site data)")
upper_floors_use_10 = ValueList({"Current use (site data)": "site", "Office - open plan": "office_open", "Office - cellular rooms": "office_cellular", "Residential - apartments": "residential", "Hotel - guest rooms": "hotel", "School - classrooms": "school", "Retail / restaurant (ground floor)": "retail"}, selected="Current use (site data)")
partition_system_10 = ValueList({"As in use profile": "as_profile", "Conventional stud": "conventional", "Demountable": "demountable", "Glazed": "glass"}, selected="As in use profile")
building_10 = Panel("B10")
overrides_json_10 = Panel("{}")
remove_walls_one_id_per_line_10 = Panel("")
floors_0_site_8_3 = Slider(0, range=0..30)
detail_full_layout_10 = BooleanToggle(False)
mvk_b10 = Python3Script(
    building=building_10,
    ground_use=ground_floor_use_10,
    use=upper_floors_use_10,
    floors=floors_0_site_8_3,
    partition_system=partition_system_10,
    detail=detail_full_layout_10,
    overrides=overrides_json_10,
    remove_walls=remove_walls_one_id_per_line_10,
    add_walls=add_walls_lines_10,
    existing_shell=existing_shell_conversion,
    show_ids=show_ids,
    show_floor=show_floor_1_all,
    export=export_to_dashboard_each_building,
    lib=lib,
    mvplus=marievik_folder,
    facade_on=facade_materials_roof_detail)  # -> out, walls, windows, doors, slabs, massing, rooms, room_pts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; inputs remove_walls: list, add_walls: list; same code as mvk_b01
b10_summary = Panel(mvk_b10.summary)

# ---- group: B11 Liljeholmskajen apartments, south slab
# Name: Liljeholmskajen apartments, south slab  (8 floors, today residential)
add_walls_lines_11 = Curve()
ground_floor_use_11 = ValueList({"Current use (site data)": "site", "Office - open plan": "office_open", "Office - cellular rooms": "office_cellular", "Residential - apartments": "residential", "Hotel - guest rooms": "hotel", "School - classrooms": "school", "Retail / restaurant (ground floor)": "retail"}, selected="Current use (site data)")
upper_floors_use_11 = ValueList({"Current use (site data)": "site", "Office - open plan": "office_open", "Office - cellular rooms": "office_cellular", "Residential - apartments": "residential", "Hotel - guest rooms": "hotel", "School - classrooms": "school", "Retail / restaurant (ground floor)": "retail"}, selected="Current use (site data)")
partition_system_11 = ValueList({"As in use profile": "as_profile", "Conventional stud": "conventional", "Demountable": "demountable", "Glazed": "glass"}, selected="As in use profile")
building_11 = Panel("B11")
overrides_json_11 = Panel("{}")
remove_walls_one_id_per_line_11 = Panel("")
floors_0_site_8_4 = Slider(0, range=0..30)
detail_full_layout_11 = BooleanToggle(False)
mvk_b11 = Python3Script(
    building=building_11,
    ground_use=ground_floor_use_11,
    use=upper_floors_use_11,
    floors=floors_0_site_8_4,
    partition_system=partition_system_11,
    detail=detail_full_layout_11,
    overrides=overrides_json_11,
    remove_walls=remove_walls_one_id_per_line_11,
    add_walls=add_walls_lines_11,
    existing_shell=existing_shell_conversion,
    show_ids=show_ids,
    show_floor=show_floor_1_all,
    export=export_to_dashboard_each_building,
    lib=lib,
    mvplus=marievik_folder,
    facade_on=facade_materials_roof_detail)  # -> out, walls, windows, doors, slabs, massing, rooms, room_pts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; inputs remove_walls: list, add_walls: list; same code as mvk_b01
b11_summary = Panel(mvk_b11.summary)

# ---- group: B12 Small apartment block
# Name: Small apartment block  (8 floors, today residential)
add_walls_lines_12 = Curve()
ground_floor_use_12 = ValueList({"Current use (site data)": "site", "Office - open plan": "office_open", "Office - cellular rooms": "office_cellular", "Residential - apartments": "residential", "Hotel - guest rooms": "hotel", "School - classrooms": "school", "Retail / restaurant (ground floor)": "retail"}, selected="Current use (site data)")
upper_floors_use_12 = ValueList({"Current use (site data)": "site", "Office - open plan": "office_open", "Office - cellular rooms": "office_cellular", "Residential - apartments": "residential", "Hotel - guest rooms": "hotel", "School - classrooms": "school", "Retail / restaurant (ground floor)": "retail"}, selected="Current use (site data)")
partition_system_12 = ValueList({"As in use profile": "as_profile", "Conventional stud": "conventional", "Demountable": "demountable", "Glazed": "glass"}, selected="As in use profile")
building_12 = Panel("B12")
overrides_json_12 = Panel("{}")
remove_walls_one_id_per_line_12 = Panel("")
floors_0_site_8_5 = Slider(0, range=0..30)
detail_full_layout_12 = BooleanToggle(False)
mvk_b12 = Python3Script(
    building=building_12,
    ground_use=ground_floor_use_12,
    use=upper_floors_use_12,
    floors=floors_0_site_8_5,
    partition_system=partition_system_12,
    detail=detail_full_layout_12,
    overrides=overrides_json_12,
    remove_walls=remove_walls_one_id_per_line_12,
    add_walls=add_walls_lines_12,
    existing_shell=existing_shell_conversion,
    show_ids=show_ids,
    show_floor=show_floor_1_all,
    export=export_to_dashboard_each_building,
    lib=lib,
    mvplus=marievik_folder,
    facade_on=facade_materials_roof_detail)  # -> out, walls, windows, doors, slabs, massing, rooms, room_pts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; inputs remove_walls: list, add_walls: list; same code as mvk_b01
b12_summary = Panel(mvk_b12.summary)

# ---- group: B13 Liljeholmskajen courtyard block
# Name: Liljeholmskajen courtyard block  (8 floors, today residential)
add_walls_lines_13 = Curve()
ground_floor_use_13 = ValueList({"Current use (site data)": "site", "Office - open plan": "office_open", "Office - cellular rooms": "office_cellular", "Residential - apartments": "residential", "Hotel - guest rooms": "hotel", "School - classrooms": "school", "Retail / restaurant (ground floor)": "retail"}, selected="Current use (site data)")
upper_floors_use_13 = ValueList({"Current use (site data)": "site", "Office - open plan": "office_open", "Office - cellular rooms": "office_cellular", "Residential - apartments": "residential", "Hotel - guest rooms": "hotel", "School - classrooms": "school", "Retail / restaurant (ground floor)": "retail"}, selected="Current use (site data)")
partition_system_13 = ValueList({"As in use profile": "as_profile", "Conventional stud": "conventional", "Demountable": "demountable", "Glazed": "glass"}, selected="As in use profile")
building_13 = Panel("B13")
overrides_json_13 = Panel("{}")
remove_walls_one_id_per_line_13 = Panel("")
floors_0_site_8_6 = Slider(0, range=0..30)
detail_full_layout_13 = BooleanToggle(False)
mvk_b13 = Python3Script(
    building=building_13,
    ground_use=ground_floor_use_13,
    use=upper_floors_use_13,
    floors=floors_0_site_8_6,
    partition_system=partition_system_13,
    detail=detail_full_layout_13,
    overrides=overrides_json_13,
    remove_walls=remove_walls_one_id_per_line_13,
    add_walls=add_walls_lines_13,
    existing_shell=existing_shell_conversion,
    show_ids=show_ids,
    show_floor=show_floor_1_all,
    export=export_to_dashboard_each_building,
    lib=lib,
    mvplus=marievik_folder,
    facade_on=facade_materials_roof_detail)  # -> out, walls, windows, doors, slabs, massing, rooms, room_pts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; inputs remove_walls: list, add_walls: list; same code as mvk_b01
b13_summary = Panel(mvk_b13.summary)

# ---- group: Previews (all buildings)
room_labels_size = Slider(0.6, range=0.1..5)
id_labels_size = Slider(0.25, range=0.1..5)
building_labels_size = Slider(2, range=0.1..5)
preview_walls = CustomPreview(
    Geometry=[mvk_b01.walls, mvk_b02.walls, mvk_b03.walls, mvk_b04.walls, mvk_b05.walls, mvk_b06.walls, mvk_b07.walls, mvk_b08.walls, mvk_b09.walls, mvk_b10.walls, mvk_b11.walls, mvk_b12.walls, mvk_b13.walls],
    Material=ColourSwatch(SwatchColor=RGB(205, 200, 190)))
preview_windows = CustomPreview(
    Geometry=[mvk_b01.windows, mvk_b02.windows, mvk_b03.windows, mvk_b04.windows, mvk_b05.windows, mvk_b06.windows, mvk_b07.windows, mvk_b08.windows, mvk_b09.windows, mvk_b10.windows, mvk_b11.windows, mvk_b12.windows, mvk_b13.windows],
    Material=ColourSwatch(SwatchColor=RGBA(62, 84, 104, 235)))
preview_doors = CustomPreview(
    Geometry=[mvk_b01.doors, mvk_b02.doors, mvk_b03.doors, mvk_b04.doors, mvk_b05.doors, mvk_b06.doors, mvk_b07.doors, mvk_b08.doors, mvk_b09.doors, mvk_b10.doors, mvk_b11.doors, mvk_b12.doors, mvk_b13.doors],
    Material=ColourSwatch(SwatchColor=RGB(160, 90, 45)))
preview_slabs = CustomPreview(
    Geometry=[mvk_b01.slabs, mvk_b02.slabs, mvk_b03.slabs, mvk_b04.slabs, mvk_b05.slabs, mvk_b06.slabs, mvk_b07.slabs, mvk_b08.slabs, mvk_b09.slabs, mvk_b10.slabs, mvk_b11.slabs, mvk_b12.slabs, mvk_b13.slabs],
    Material=ColourSwatch(SwatchColor=RGB(235, 235, 235)))
preview_rooms = CustomPreview(
    Geometry=[mvk_b01.rooms, mvk_b02.rooms, mvk_b03.rooms, mvk_b04.rooms, mvk_b05.rooms, mvk_b06.rooms, mvk_b07.rooms, mvk_b08.rooms, mvk_b09.rooms, mvk_b10.rooms, mvk_b11.rooms, mvk_b12.rooms, mvk_b13.rooms],
    Material=ColourSwatch(SwatchColor=RGB(200, 60, 60)))
preview_facade = CustomPreview(
    Geometry=[mvk_b01.facade, mvk_b02.facade, mvk_b03.facade, mvk_b04.facade, mvk_b05.facade, mvk_b06.facade, mvk_b07.facade, mvk_b08.facade, mvk_b09.facade, mvk_b10.facade, mvk_b11.facade, mvk_b12.facade, mvk_b13.facade],
    Material=[mvk_b01.facade_col, mvk_b02.facade_col, mvk_b03.facade_col, mvk_b04.facade_col, mvk_b05.facade_col, mvk_b06.facade_col, mvk_b07.facade_col, mvk_b08.facade_col, mvk_b09.facade_col, mvk_b10.facade_col, mvk_b11.facade_col, mvk_b12.facade_col, mvk_b13.facade_col])
preview_details = CustomPreview(
    Geometry=[mvk_b01.details, mvk_b02.details, mvk_b03.details, mvk_b04.details, mvk_b05.details, mvk_b06.details, mvk_b07.details, mvk_b08.details, mvk_b09.details, mvk_b10.details, mvk_b11.details, mvk_b12.details, mvk_b13.details],
    Material=[mvk_b01.details_col, mvk_b02.details_col, mvk_b03.details_col, mvk_b04.details_col, mvk_b05.details_col, mvk_b06.details_col, mvk_b07.details_col, mvk_b08.details_col, mvk_b09.details_col, mvk_b10.details_col, mvk_b11.details_col, mvk_b12.details_col, mvk_b13.details_col])
preview_massing = CustomPreview(
    Geometry=[mvk_b01.massing, mvk_b02.massing, mvk_b03.massing, mvk_b04.massing, mvk_b05.massing, mvk_b06.massing, mvk_b07.massing, mvk_b08.massing, mvk_b09.massing, mvk_b10.massing, mvk_b11.massing, mvk_b12.massing, mvk_b13.massing],
    Material=[mvk_b01.massing_col, mvk_b02.massing_col, mvk_b03.massing_col, mvk_b04.massing_col, mvk_b05.massing_col, mvk_b06.massing_col, mvk_b07.massing_col, mvk_b08.massing_col, mvk_b09.massing_col, mvk_b10.massing_col, mvk_b11.massing_col, mvk_b12.massing_col, mvk_b13.massing_col])
room_labels = TextTag3D(
    Location=[mvk_b01.room_pts, mvk_b02.room_pts, mvk_b03.room_pts, mvk_b04.room_pts, mvk_b05.room_pts, mvk_b06.room_pts, mvk_b07.room_pts, mvk_b08.room_pts, mvk_b09.room_pts, mvk_b10.room_pts, mvk_b11.room_pts, mvk_b12.room_pts, mvk_b13.room_pts],
    Text=[mvk_b01.room_txt, mvk_b02.room_txt, mvk_b03.room_txt, mvk_b04.room_txt, mvk_b05.room_txt, mvk_b06.room_txt, mvk_b07.room_txt, mvk_b08.room_txt, mvk_b09.room_txt, mvk_b10.room_txt, mvk_b11.room_txt, mvk_b12.room_txt, mvk_b13.room_txt],
    Size=room_labels_size,
    Justification=7)
id_labels = TextTag3D(
    Location=[mvk_b01.id_pts, mvk_b02.id_pts, mvk_b03.id_pts, mvk_b04.id_pts, mvk_b05.id_pts, mvk_b06.id_pts, mvk_b07.id_pts, mvk_b08.id_pts, mvk_b09.id_pts, mvk_b10.id_pts, mvk_b11.id_pts, mvk_b12.id_pts, mvk_b13.id_pts],
    Text=[mvk_b01.id_txt, mvk_b02.id_txt, mvk_b03.id_txt, mvk_b04.id_txt, mvk_b05.id_txt, mvk_b06.id_txt, mvk_b07.id_txt, mvk_b08.id_txt, mvk_b09.id_txt, mvk_b10.id_txt, mvk_b11.id_txt, mvk_b12.id_txt, mvk_b13.id_txt],
    Size=id_labels_size,
    Justification=7)
building_labels = TextTag3D(
    Location=[mvk_b01.ctx_pts, mvk_b02.ctx_pts, mvk_b03.ctx_pts, mvk_b04.ctx_pts, mvk_b05.ctx_pts, mvk_b06.ctx_pts, mvk_b07.ctx_pts, mvk_b08.ctx_pts, mvk_b09.ctx_pts, mvk_b10.ctx_pts, mvk_b11.ctx_pts, mvk_b12.ctx_pts, mvk_b13.ctx_pts],
    Text=[mvk_b01.ctx_txt, mvk_b02.ctx_txt, mvk_b03.ctx_txt, mvk_b04.ctx_txt, mvk_b05.ctx_txt, mvk_b06.ctx_txt, mvk_b07.ctx_txt, mvk_b08.ctx_txt, mvk_b09.ctx_txt, mvk_b10.ctx_txt, mvk_b11.ctx_txt, mvk_b12.ctx_txt, mvk_b13.ctx_txt],
    Size=building_labels_size,
    Justification=7)

# ---- group: Site summary
mvk_site_summary = Python3Script(
    models=[mvk_b01.model, mvk_b02.model, mvk_b03.model, mvk_b04.model, mvk_b05.model, mvk_b06.model, mvk_b07.model, mvk_b08.model, mvk_b09.model, mvk_b10.model, mvk_b11.model, mvk_b12.model, mvk_b13.model],
    lib=lib)  # -> out, summary, table; inputs models: list
# ---------- mvk_site_summary: Python ----------
#! python3
# r: shapely
# MVK Site summary: the real code lives in <lib>/gh/mvk_site_summary.py (edit it there, then recompute).
import os
_LIB = lib if lib else r"C:\Users\saraabo\Desktop\Marievik_parametric"
exec(open(os.path.join(_LIB, "gh", "mvk_site_summary.py"), encoding="utf-8").read())
# ---------- end mvk_site_summary ----------
site_summary = Panel(mvk_site_summary.summary)
