# Grasshopper definition Marievik_massing.gh (Grasshopper 1.0.8)

footprints = Curve(<curve referenced from the Rhino model>)
# README: 1) Right-click Footprints > Set Multiple Curves: pick closed footprint curves (courtyards = inner curves).
# 2) Floors per building: one number per line, same order as the curves.
# 3) Floor height slider applies to all floors.
# 4) Right-click Floors (Extrude) > Bake to add solids to Rhino.
floors_per_building = Panel("8")
floor_height_m = Slider(3.5, range=2.5..6)
boundary = BoundarySurfaces(Edges=footprints)
series = Series(Start=0, Step=floor_height_m, Count=graft(floors_per_building))
floor_levels = UnitZ(Factor=series)
move = Move(Geometry=graft(boundary), Motion=floor_levels)  # -> Geometry, Transform
floor_height = UnitZ(Factor=floor_height_m)
floors = Extrude(Base=move.Geometry, Direction=floor_height)
footprint_area = Area(Geometry=boundary)  # -> Area, Centroid
gfa_per_building = Multiplication(A=footprint_area.Area, B=floors_per_building)
total_gfa = MassAddition(Input=gfa_per_building)  # -> Result, PartialResults
footprint_area_m2 = Panel(footprint_area.Area)
gfa_per_building_m2 = Panel(gfa_per_building)
total_gfa_m2 = Panel(total_gfa.Result)
